# Grasshopper definition resident_gen.gh (Grasshopper 1.0.8)

building_length = Slider(52, range=0..100)
building_width = Slider(39, range=0..100)
floors = Slider(7, range=0..100)
floor_height = Slider(3.2, range=0..10)
pilotis_height = Slider(2.8, range=0..10)
slab_thickness = Slider(0.3, range=0..1)
column_size = Slider(0.3, range=0..1)
grid_x = Slider(8, range=0..11)
grid_y = Slider(7, range=0..10)
core_width = Slider(6, range=0..10)
core_depth = Slider(11, range=0..15)
core_position = Slider(0, range=0..1)
num_bars = Slider(2, range=0..10)
bgr_category = Slider(0, range=0..4)
room_width = Slider(6, range=0..10)
layout_type = Slider(2, range=0..3)
rooms_across = Slider(2, range=0..10)
corridor_width = Slider(2.6, range=0..10)
bgr_residential_massing_generator_py = Python3Script(
    building_length=building_length,
    building_width=building_width,
    floors=floors,
    floor_height=floor_height,
    pilotis_height=pilotis_height,
    slab_thickness=slab_thickness,
    column_size=column_size,
    grid_x=grid_x,
    grid_y=grid_y,
    core_width=core_width,
    core_depth=core_depth,
    core_position=core_position,
    num_bars=num_bars,
    bgr_category=bgr_category)  # -> out, Ground_Breps, Column_Breps, Residential_Breps, Core_Brep, Preview_Colors, Layer_Names, BGR_Category; inputs building_length: Double, building_width: Double, floors: Int32, floor_height: Double, pilotis_height: Double, slab_thickness: Double, column_size: Double, grid_x: Int32, grid_y: Int32, core_width: Double, core_depth: Double, core_position: Int32, num_bars: Int32, bgr_category: Int32
# ---------- bgr_residential_massing_generator_py: Python ----------
# -*- coding: utf-8 -*-
# MaCAD S.3 - Graph ML Assignment 3
# Parametric residential building - Building-Ground Relationship (BGR) generator
# GHPython component (IronPython 2.7 / RhinoCommon)
#
# Outputs four closed-solid groups whose names match the Assignment 3 notebook:
#   ground / columns / offices (residential) / core
#
# BGR selector (bgr_category):
#   0 Separation              1 Separation with Plinth
#   2 Adherence               3 Adherence with Plinth
#   4 Interlock

import Rhino
import Rhino.Geometry as rg
import scriptcontext as sc
import System.Drawing as sd
from Grasshopper.Kernel import GH_RuntimeMessageLevel as RML

# ----------------------------------------------------------------------
# Tolerance
# ----------------------------------------------------------------------
TOL = 0.001
try:
    if sc.doc is not None and sc.doc.ModelAbsoluteTolerance > 0:
        TOL = sc.doc.ModelAbsoluteTolerance
except:
    pass
EPS = TOL * 5.0

def warn(msg):
    try:
        ghenv.Component.AddRuntimeMessage(RML.Warning, msg)
    except:
        pass

# ----------------------------------------------------------------------
# Defaults so the component runs with unconnected inputs
# ----------------------------------------------------------------------
def dflt(v, d):
    return d if v is None else v

building_length = float(dflt(building_length, 24.0))
building_width  = float(dflt(building_width, 12.0))
floors          = int(dflt(floors, 4))
floor_height    = float(dflt(floor_height, 3.0))
pilotis_height  = float(dflt(pilotis_height, 3.5))
slab_thickness  = float(dflt(slab_thickness, 0.6))
column_size     = float(dflt(column_size, 0.5))
grid_x          = int(dflt(grid_x, 4))
grid_y          = int(dflt(grid_y, 3))
core_width      = float(dflt(core_width, 4.0))
core_depth      = float(dflt(core_depth, 3.0))
core_position   = int(dflt(core_position, 0))
num_bars        = int(dflt(num_bars, 1))
bgr_category    = int(dflt(bgr_category, 0))

floors   = max(1, floors)
grid_x   = max(2, grid_x)
grid_y   = max(2, grid_y)
num_bars = 2 if num_bars == 2 else 1
if bgr_category < 0 or bgr_category > 4:
    warn("bgr_category out of range; defaulting to 0 (Separation).")
    bgr_category = 0
cat = bgr_category

# ----------------------------------------------------------------------
# Geometry helpers
# ----------------------------------------------------------------------
def box_brep(x0, x1, y0, y1, z0, z1):
    if x1 < x0: x0, x1 = x1, x0
    if y1 < y0: y0, y1 = y1, y0
    if z1 < z0: z0, z1 = z1, z0
    bx = rg.Box(rg.Plane.WorldXY,
                rg.Interval(x0, x1),
                rg.Interval(y0, y1),
                rg.Interval(z0, z1))
    return bx.ToBrep()

def subtract(base, cutter):
    res = rg.Brep.CreateBooleanDifference([base], [cutter], TOL)
    if res is None or len(res) == 0:
        warn("Boolean difference failed; kept original solid (check core size).")
        return base
    if len(res) == 1:
        return res[0]
    joined = rg.Brep.JoinBreps(res, TOL)
    return joined[0] if (joined and len(joined) > 0) else res[0]

def linspace(a, b, n):
    if n <= 1:
        return [0.5 * (a + b)]
    s = (b - a) / float(n - 1)
    return [a + i * s for i in range(n)]

# ----------------------------------------------------------------------
# Level logic driven by the BGR category
# ----------------------------------------------------------------------
L  = building_length
W  = building_width
t  = slab_thickness
fh = floor_height
ph = max(pilotis_height, 0.1)
cs = column_size

has_columns  = cat in (0, 1)
has_plinth   = cat in (1, 3)
is_interlock = (cat == 4)

plinth_h    = fh          # derived: one-storey podium
embed_depth = fh          # derived: one storey embedded (interlock)

# ground slab must be deep enough to hold the interlock pit
if is_interlock and t < embed_depth + 0.2 * fh:
    t = embed_depth + 0.2 * fh

ground_top  = t
plinth_top  = ground_top + plinth_h if has_plinth else ground_top
support_top = plinth_top   # columns / volume bear on this level

if   cat == 0: base_z = ground_top + ph           # separation
elif cat == 1: base_z = plinth_top + ph           # separation + plinth
elif cat == 2: base_z = ground_top                # adherence
elif cat == 3: base_z = plinth_top                # adherence + plinth
elif cat == 4: base_z = ground_top - embed_depth  # interlock
else:          base_z = ground_top + ph

roof_top = base_z + floors * fh

# ----------------------------------------------------------------------
# Footprints
# ----------------------------------------------------------------------
gm = max(L, W) * 0.30      # ground apron margin
pm = max(L, W) * 0.12      # plinth margin (< gm so ground covers plinth)
g_x0, g_x1 = -gm, L + gm
g_y0, g_y1 = -gm, W + gm

cw = min(core_width, L * 0.5)
cd = min(core_depth, W * 0.6)

bars = []          # list of (x0,x1,y0,y1)
core_in_gap = False
if num_bars == 1:
    bars.append((0.0, L, 0.0, W))
    core_x0, core_x1 = 0.5 * (L - cw), 0.5 * (L + cw)
    core_y0, core_y1 = 0.5 * (W - cd), 0.5 * (W + cd)
else:
    gap = cd
    bar_depth = 0.5 * (W - gap)
    if bar_depth <= 0.5:
        warn("core_depth too large for two bars; reverting to one bar.")
        num_bars = 1
        bars.append((0.0, L, 0.0, W))
        core_x0, core_x1 = 0.5 * (L - cw), 0.5 * (L + cw)
        core_y0, core_y1 = 0.5 * (W - cd), 0.5 * (W + cd)
    else:
        bars.append((0.0, L, 0.0, bar_depth))
        bars.append((0.0, L, W - bar_depth, W))
        core_x0, core_x1 = 0.5 * (L - cw), 0.5 * (L + cw)
        core_y0, core_y1 = bar_depth, W - bar_depth
        core_in_gap = True

core_z0 = base_z if is_interlock else ground_top
core_z1 = roof_top

# ----------------------------------------------------------------------
# RESIDENTIAL VOLUME (one closed solid per floor per bar)
# ----------------------------------------------------------------------
residential = []
for fi in range(floors):
    z0 = base_z + fi * fh
    z1 = z0 + fh
    for (bx0, bx1, by0, by1) in bars:
        fb = box_brep(bx0, bx1, by0, by1, z0, z1)
        if not core_in_gap:   # central core: notch it out of each floor
            cutter = box_brep(core_x0, core_x1, core_y0, core_y1, z0 - EPS, z1 + EPS)
            fb = subtract(fb, cutter)
        residential.append(fb)

# ----------------------------------------------------------------------
# CORE (single vertical closed solid, ground -> roof)
# ----------------------------------------------------------------------
core_breps = [box_brep(core_x0, core_x1, core_y0, core_y1, core_z0, core_z1)]

# ----------------------------------------------------------------------
# PLINTH (assigned to the GROUND group; notch the core through it)
# ----------------------------------------------------------------------
plinth_breps = []
if has_plinth:
    pb = box_brep(-pm, L + pm, -pm, W + pm, ground_top, plinth_top)
    cutter = box_brep(core_x0, core_x1, core_y0, core_y1, ground_top - EPS, plinth_top + EPS)
    pb = subtract(pb, cutter)
    plinth_breps.append(pb)

# ----------------------------------------------------------------------
# GROUND SLAB (+ interlock pit)
# ----------------------------------------------------------------------
ground = box_brep(g_x0, g_x1, g_y0, g_y1, 0.0, ground_top)
if is_interlock:
    for (bx0, bx1, by0, by1) in bars:
        cutter = box_brep(bx0, bx1, by0, by1, base_z - EPS, ground_top + EPS)
        ground = subtract(ground, cutter)
ground_breps = [ground] + plinth_breps

# ----------------------------------------------------------------------
# COLUMNS (only for separation categories)
# ----------------------------------------------------------------------
column_breps = []
if has_columns:
    xs = linspace(cs * 0.5, L - cs * 0.5, grid_x)
    ys = linspace(cs * 0.5, W - cs * 0.5, grid_y)
    cz0, cz1 = support_top, base_z
    for x in xs:
        for y in ys:
            # skip under the core footprint
            if (core_x0 - cs <= x <= core_x1 + cs) and (core_y0 - cs <= y <= core_y1 + cs):
                continue
            # skip the central gap when two bars
            if num_bars == 2 and (bars[0][3] < y < bars[1][2]):
                continue
            column_breps.append(box_brep(x - cs*0.5, x + cs*0.5,
                                         y - cs*0.5, y + cs*0.5,
                                         cz0, cz1))

# ----------------------------------------------------------------------
# VALIDATION
# ----------------------------------------------------------------------
def validate(breps, name):
    ok = True
    for i, b in enumerate(breps):
        if b is None or not b.IsValid:
            warn("%s[%d] is null/invalid." % (name, i)); ok = False
        elif not b.IsSolid:
            warn("%s[%d] is not a closed solid." % (name, i)); ok = False
    return ok

all_ok = True
all_ok = all_ok and validate(ground_breps, "ground")
all_ok = all_ok and validate(column_breps, "columns")
all_ok = all_ok and validate(residential,  "offices")
all_ok = all_ok and validate(core_breps,   "core")

# ----------------------------------------------------------------------
# OUTPUTS
# ----------------------------------------------------------------------
Ground_Breps      = ground_breps
Column_Breps      = column_breps
Residential_Breps = residential
Core_Brep         = core_breps

Preview_Colors = [sd.Color.FromArgb(150, 150, 150),   # ground
                  sd.Color.FromArgb(60, 60, 70),      # columns
                  sd.Color.FromArgb(70, 130, 200),    # offices
                  sd.Color.FromArgb(210, 120, 50)]    # core
Layer_Names = ["ground", "columns", "offices", "core"]

names = {0: "Separation", 1: "Separation with Plinth", 2: "Adherence",
         3: "Adherence with Plinth", 4: "Interlock"}
BGR_Category = "%d - %s" % (cat, names.get(cat, "Separation"))

print("Valid & closed" if all_ok else "Validation issues - see warnings")
print("Category: " + BGR_Category)
print("Counts -> ground:%d columns:%d offices:%d core:%d" % (
    len(ground_breps), len(column_breps), len(residential), len(core_breps)))
# ---------- end bgr_residential_massing_generator_py ----------
residential_interior_layout_generator_py = Python3Script(
    Residential_Breps=bgr_residential_massing_generator_py.Residential_Breps,
    wall_thickness=Slider(0.2, range=0.15..1),
    Core_Brep=bgr_residential_massing_generator_py.Core_Brep,
    corridor_width=corridor_width,
    apt_width=room_width,
    layout_type=layout_type,
    seed=Slider(369, range=0..1000),
    compute_walls=Toggle(False))  # -> out, Interior_Breps, Space_Types, Apartment_Id, Floor_Index, Space_Colors, Corridor_Breps, Wall_Breps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; inputs Residential_Breps: list of Brep, Core_Brep: list of Brep, corridor_width: Double, apt_width: Double, layout_type: Int32, seed: Int32, compute_walls: Boolean
# ---------- residential_interior_layout_generator_py: Python ----------
# Complex apartments + thin cross-corridor lobby
# Now with WALL THICKNESS + DOOR/WINDOW OPENINGS
# Rhino 8 Script Editor / Python 3
# Residential_Breps and Core_Brep inputs = LIST access.
#
# INPUTS (add wall_thickness; rest unchanged):
#   Residential_Breps (list)  Core_Brep (list)
#   apt_width  corridor_width  layout_type  seed  wall_thickness
#
# OUTPUTS to wire on the component:
#   Interior_Breps   Space_Types   Apartment_Id   Floor_Index   Space_Colors
#   Corridor_Breps
#   Wall_Breps       Wall_Colors            <-- NEW
#   Door_Breps       Window_Breps           <-- NEW (indicative opening volumes)

import Rhino
import Rhino.Geometry as rg
import scriptcontext as sc
import System.Drawing as sd

from Grasshopper.Kernel import GH_RuntimeMessageLevel as RML


# ------------------------------------------------------------
# Tolerance
# ------------------------------------------------------------

TOL = 0.001

try:
    if sc.doc and sc.doc.ModelAbsoluteTolerance > 0:
        TOL = sc.doc.ModelAbsoluteTolerance
except:
    pass

EPS = TOL * 5.0


# ------------------------------------------------------------
# Helpers
# ------------------------------------------------------------

def warn(m):
    try:
        ghenv.Component.AddRuntimeMessage(RML.Warning, m)
    except:
        pass


def dflt(v, d):
    return d if v is None else v


apt_width = float(dflt(apt_width, 6.5))
corridor_width = float(dflt(corridor_width, 1.6))
layout_type = int(dflt(layout_type, 0))
seed = int(dflt(seed, 0))

# NEW input. Thickness of every interior/exterior wall (model units).
wall_thickness = float(dflt(wall_thickness, 0.2))

# Toggle: when False, skip all wall/door/window geometry (much faster).
compute_walls = bool(dflt(compute_walls, True))

# Opening sizes (tweak freely; could be promoted to component inputs).
DOOR_W = 0.9
DOOR_H = 2.1
WIN_W = 1.3
WIN_H = 1.3
WIN_SILL = 0.9

floors_in = [b for b in (Residential_Breps or []) if b and b.IsValid]
cores_in = [b for b in (Core_Brep or []) if b and b.IsValid]

if not floors_in:
    warn("No valid Residential_Breps connected.")


def box_brep(x0, x1, y0, y1, z0, z1):
    if x1 < x0:
        x0, x1 = x1, x0

    if y1 < y0:
        y0, y1 = y1, y0

    if z1 < z0:
        z0, z1 = z1, z0

    if min(x1 - x0, y1 - y0, z1 - z0) < EPS:
        return None

    return rg.Box(
        rg.Plane.WorldXY,
        rg.Interval(x0, x1),
        rg.Interval(y0, y1),
        rg.Interval(z0, z1)
    ).ToBrep()


def aabb(b):
    return b.GetBoundingBox(True)


def overlap(b1, b2):
    return not (
        b1.Max.X <= b2.Min.X + EPS or
        b1.Min.X >= b2.Max.X - EPS or
        b1.Max.Y <= b2.Min.Y + EPS or
        b1.Min.Y >= b2.Max.Y - EPS or
        b1.Max.Z <= b2.Min.Z + EPS or
        b1.Min.Z >= b2.Max.Z - EPS
    )


core_bbs = [aabb(c) for c in cores_in]


def carve(cell):
    if cell is None:
        return []

    hit = [c for c, bb in zip(cores_in, core_bbs) if overlap(aabb(cell), bb)]

    if not hit:
        return [cell]

    res = rg.Brep.CreateBooleanDifference([cell], hit, TOL)

    if res is None:
        return [cell]

    return [r for r in res if r and r.IsSolid]


# ------------------------------------------------------------
# Apartment split grammar
# ------------------------------------------------------------

def leaf(l):
    return {"leaf": l}


def vsplit(*p):
    return {
        "axis": "v",
        "parts": list(p)
    }


def usplit(*p):
    return {
        "axis": "u",
        "parts": list(p)
    }


def eval_split(node, u0, u1, v0, v1, out):
    if "leaf" in node:
        out.append((u0, u1, v0, v1, node["leaf"]))
        return

    parts = node["parts"]
    total = float(sum(w for w, _ in parts))

    if node["axis"] == "u":
        x = u0

        for w, ch in parts:
            x1 = x + (u1 - u0) * w / total
            eval_split(ch, x, x1, v0, v1, out)
            x = x1

    else:
        y = v0

        for w, ch in parts:
            y1 = y + (v1 - v0) * w / total
            eval_split(ch, u0, u1, y, y1, out)
            y = y1


# Hall-as-spine layout (u axis: left-column | Hall | right-column).
# Hall occupies a full-depth central strip (v=0→1) so it shares an edge
# with every room in both columns simultaneously — no room requires passing
# through another room to reach Hall.

STUDIO = usplit(
    (1.0, vsplit(                  # left column: service zone
        (1.5, leaf("Bath")),       # Bath: corridor side, no facade
        (2.0, leaf("Kitchen"))     # Kitchen: facade side (acceptable in studio)
    )),
    (0.6, leaf("Hall")),           # spine: touches Bath, Kitchen, Living
    (2.0, leaf("Living"))          # right column: full depth → facade
)

ONEBED = usplit(
    (1.2, vsplit(                  # left column: private zone
        (1.5, leaf("Bath")),       # Bath: corridor side, service, no facade
        (2.5, leaf("Bedroom"))     # Bedroom: facade ✓
    )),
    (0.6, leaf("Hall")),           # spine: touches Bath, Bedroom, Kitchen, Living
    (1.5, vsplit(                  # right column: living zone
        (1.5, leaf("Kitchen")),    # Kitchen: corridor side, service, no facade
        (2.5, leaf("Living"))      # Living: facade ✓
    ))
)

# TWOBED — Hall-spine layout preserves direct access from Hall to all five rooms.
# Living and Bedroom1 receive facade priority (v→1.0).
# Bedroom2 remains in the middle zone: the rectangular grammar cannot give Hall
# access to five rooms while also placing Living, Bedroom1, and Bedroom2 all at
# facade. A future L-shaped Hall primitive would resolve this.
TWOBED = usplit(
    (1.2, vsplit(                  # left column: private zone
        (1.5, leaf("Bath")),       # Bath: corridor side, service, no facade
        (2.5, leaf("Bedroom1"))    # Bedroom1: facade ✓
    )),
    (0.6, leaf("Hall")),           # spine: touches Bath, Bedroom1, Kitchen, Bedroom2, Living
    (1.5, vsplit(                  # right column: mixed living zone
        (1.0, leaf("Kitchen")),    # Kitchen: corridor side, no facade
        (2.0, leaf("Bedroom2")),   # Bedroom2: middle zone (see limitations)
        (2.0, leaf("Living"))      # Living: facade ✓
    ))
)

TYPES = [STUDIO, ONEBED, TWOBED]


# ------------------------------------------------------------
# Colors
# ------------------------------------------------------------

COL = {
    "Living": (150, 180, 225),
    "Kitchen": (235, 170, 90),
    "Bath": (110, 200, 200),
    "Bedroom": (150, 205, 150),
    "Bedroom1": (150, 205, 150),
    "Bedroom2": (125, 185, 135),
    "Hall": (205, 205, 210),
    "Corridor": (170, 170, 175)
}

WALL_COL = sd.Color.FromArgb(120, 120, 128)


def color(l):
    r, g, b = COL.get(l, (200, 200, 200))
    return sd.Color.FromArgb(r, g, b)


# ------------------------------------------------------------
# Outputs
# ------------------------------------------------------------

Interior_Breps = []
Space_Types = []
Apartment_Id = []
Floor_Index = []
Space_Colors = []
Corridor_Breps = []

Wall_Breps = []
Wall_Colors = []
Door_Breps = []
Window_Breps = []

Label_Points = []
Label_Text = []

apt = 0
tindex = seed

floors_sorted = sorted(floors_in, key=lambda b: aabb(b).Min.Z)


def emit(brep, label, aid, fi):
    # Emits a "space" volume (room interior or corridor).
    for p in carve(brep):
        if p is None or not p.IsSolid:
            continue

        Interior_Breps.append(p)
        Space_Types.append(label)
        Apartment_Id.append(aid)
        Floor_Index.append(fi)
        Space_Colors.append(color(label))

        bb_p = p.GetBoundingBox(True)
        cx = 0.5 * (bb_p.Min.X + bb_p.Max.X)
        cy = 0.5 * (bb_p.Min.Y + bb_p.Max.Y)
        Label_Points.append(rg.Point3d(cx, cy, bb_p.Min.Z))

        display_label = label

        if label in ["Bedroom1", "Bedroom2"]:
            display_label = "Bedroom"

        if aid < 0:
            Label_Text.append(display_label)
        else:
            Label_Text.append("%s\nApt %d" % (display_label, aid))

        if label == "Corridor":
            Corridor_Breps.append(p)


def emit_wall(brep):
    for p in carve(brep):
        if p and p.IsSolid:
            Wall_Breps.append(p)
            Wall_Colors.append(WALL_COL)


# ------------------------------------------------------------
# Main layout generation
# ------------------------------------------------------------

for fi, fb in enumerate(floors_sorted):
    bb = aabb(fb)

    x0 = bb.Min.X
    x1 = bb.Max.X
    y0 = bb.Min.Y
    y1 = bb.Max.Y
    z0 = bb.Min.Z
    z1 = bb.Max.Z

    fh = z1 - z0

    long_is_x = (x1 - x0) >= (y1 - y0)

    if long_is_x:
        a0, a1 = x0, x1
        c0, c1 = y0, y1
    else:
        a0, a1 = y0, y1
        c0, c1 = x0, x1

    across = c1 - c0

    # Map (along, across) -> world box at full floor height.
    def AAB(al0, al1, ac0, ac1):
        if long_is_x:
            return box_brep(al0, al1, ac0, ac1, z0, z1)
        else:
            return box_brep(ac0, ac1, al0, al1, z0, z1)

    # Same mapping but with an explicit z range (for openings + walls).
    def AABz(al0, al1, ac0, ac1, zlo, zhi):
        if long_is_x:
            return box_brep(al0, al1, ac0, ac1, zlo, zhi)
        else:
            return box_brep(ac0, ac1, al0, al1, zlo, zhi)

    def place(node, al0, al1, ci, cfac):
        # Returns leaf records, keeping the unit-square coords so we can tell
        # which edges are interior partitions vs corridor vs facade.
        leaves = []
        eval_split(node, 0.0, 1.0, 0.0, 1.0, leaves)

        out = []

        for u0, u1, v0, v1, lab in leaves:
            aL0 = al0 + (al1 - al0) * u0
            aL1 = al0 + (al1 - al0) * u1

            cR0 = ci + (cfac - ci) * v0   # corridor-facing side
            cR1 = ci + (cfac - ci) * v1   # facade-facing side

            out.append((aL0, aL1, cR0, cR1, u0, u1, v0, v1, lab))

        return out

    def open_across(C, w, zlo, zhi, amin, amax):
        # Opening in a wall that runs ALONG the building (constant across=C).
        ac = 0.5 * (amin + amax)
        ww = min(w, (amax - amin) * 0.8)
        t = wall_thickness
        cut = AABz(ac - 0.5 * ww, ac + 0.5 * ww, C - t, C + t, zlo, zhi)
        pan = AABz(ac - 0.5 * ww, ac + 0.5 * ww, C - 0.5 * t, C + 0.5 * t, zlo, zhi)
        return cut, pan

    def open_along(A, w, zlo, zhi, cmin, cmax):
        # Opening in a wall PERPENDICULAR to the building (constant along=A).
        cc = 0.5 * (cmin + cmax)
        ww = min(w, (cmax - cmin) * 0.8)
        t = wall_thickness
        cut = AABz(A - t, A + t, cc - 0.5 * ww, cc + 0.5 * ww, zlo, zhi)
        pan = AABz(A - 0.5 * t, A + 0.5 * t, cc - 0.5 * ww, cc + 0.5 * ww, zlo, zhi)
        return cut, pan

    def emit_room(rec, aid, fi, end_lo, end_hi):
        aL0, aL1, cR0, cR1, u0, u1, v0, v1, lab = rec

        t = wall_thickness
        ht = 0.5 * t

        amin, amax = (aL0, aL1) if aL0 <= aL1 else (aL1, aL0)

        # Which edges are building-exterior short facades?
        ext_lo = end_lo and (u0 <= 1e-9)
        ext_hi = end_hi and (u1 >= 1.0 - 1e-9)

        is_corridor = (v0 <= 1e-9)        # cR0 side faces the real corridor
        is_facade = (v1 >= 1.0 - 1e-9)    # cR1 side faces the building facade

        # Per-side wall thickness: full t on a true exterior/corridor wall,
        # half t on a shared partition (the neighbour supplies the other half).
        ia_lo = t if ext_lo else ht
        ia_hi = t if ext_hi else ht
        inset_cR0 = t if is_corridor else ht
        inset_cR1 = t if is_facade else ht

        # Map corridor/facade insets onto numeric min/max.
        if cR0 <= cR1:
            cmin, cmax = cR0, cR1
            ic_lo, ic_hi = inset_cR0, inset_cR1
        else:
            cmin, cmax = cR1, cR0
            ic_lo, ic_hi = inset_cR1, inset_cR0

        full = AAB(amin, amax, cmin, cmax)
        if full is None:
            return

        if not compute_walls:
            emit(full, lab, aid, fi)
            return

        in_a0 = amin + ia_lo
        in_a1 = amax - ia_hi
        in_c0 = cmin + ic_lo
        in_c1 = cmax - ic_hi

        # Degenerate (too small to host walls): emit as a plain space.
        if (in_a1 - in_a0) <= EPS or (in_c1 - in_c0) <= EPS:
            emit(full, lab, aid, fi)
            return

        interior = AAB(in_a0, in_a1, in_c0, in_c1)

        # Opening z-ranges (clamped to floor height).
        d_zhi = z0 + min(DOOR_H, fh - 0.05)
        w_zlo = z0 + min(WIN_SILL, 0.5 * fh)
        w_zhi = z0 + min(WIN_SILL + WIN_H, fh - 0.05)

        voids = []
        doors = []
        windows = []

        # corridor/inner side (cR0): always a door (entry, or to sibling room)
        cut, pan = open_across(cR0, DOOR_W, z0, d_zhi, amin, amax)
        if cut:
            voids.append(cut)
        if pan:
            doors.append(pan)

        # facade side
        if is_facade:
            cut, pan = open_across(cR1, WIN_W, w_zlo, w_zhi, amin, amax)
            if cut:
                voids.append(cut)
            if pan:
                windows.append(pan)
        else:
            cut, pan = open_across(cR1, DOOR_W, z0, d_zhi, amin, amax)
            if cut:
                voids.append(cut)
            if pan:
                doors.append(pan)

        # along-min short side
        if ext_lo:
            cut, pan = open_along(amin, WIN_W, w_zlo, w_zhi, cmin, cmax)
            if cut:
                voids.append(cut)
            if pan:
                windows.append(pan)
        elif u0 > 1e-9:
            cut, pan = open_along(amin, DOOR_W, z0, d_zhi, cmin, cmax)
            if cut:
                voids.append(cut)
            if pan:
                doors.append(pan)

        # along-max short side
        if ext_hi:
            cut, pan = open_along(amax, WIN_W, w_zlo, w_zhi, cmin, cmax)
            if cut:
                voids.append(cut)
            if pan:
                windows.append(pan)
        elif u1 < 1.0 - 1e-9:
            cut, pan = open_along(amax, DOOR_W, z0, d_zhi, cmin, cmax)
            if cut:
                voids.append(cut)
            if pan:
                doors.append(pan)

        # --- build wall = full - interior - openings (single boolean) ---
        subtract = [interior] + voids
        res = rg.Brep.CreateBooleanDifference([full], subtract, TOL)

        if not res:
            # retry: hollow only (no openings) so we never lose the wall
            res = rg.Brep.CreateBooleanDifference([full], [interior], TOL)

        if res:
            for r in res:
                if r and r.IsSolid:
                    emit_wall(r)
        else:
            emit_wall(full)  # last-resort: solid block

        # room clear space + indicative opening volumes
        emit(interior, lab, aid, fi)
        Door_Breps.extend(doors)
        Window_Breps.extend(windows)

    # --------------------------------------------------------
    # Thin transverse cross-corridor at the core
    # --------------------------------------------------------

    spans = [(a0, a1)]

    if cores_in:
        if long_is_x:
            kmin = min(b.Min.X for b in core_bbs)
            kmax = max(b.Max.X for b in core_bbs)
        else:
            kmin = min(b.Min.Y for b in core_bbs)
            kmax = max(b.Max.Y for b in core_bbs)

        if kmax > a0 and kmin < a1:
            kcen = 0.5 * (kmin + kmax)

            tw = min(corridor_width, (a1 - a0) * 0.4)

            tca0 = max(a0, kcen - tw / 2.0)
            tca1 = min(a1, kcen + tw / 2.0)

            emit(AAB(tca0, tca1, c0, c1), "Corridor", -1, fi)

            spans = [(a0, tca0), (tca1, a1)]

    # --------------------------------------------------------
    # Fill remaining spans with apartments and main corridors
    # --------------------------------------------------------

    for s0, s1 in spans:
        span = s1 - s0

        if span <= EPS:
            continue

        if span < apt_width * 0.6:
            emit(AAB(s0, s1, c0, c1), "Corridor", -1, fi)
            continue

        nn = max(1, int(round(span / apt_width)))
        st = span / nn

        e = [s0 + i * st for i in range(nn + 1)]

        # Corridor bounds are constant across all bays in this span.
        if layout_type == 1:
            cw = min(corridor_width, across * 0.5)
            clo = c0
            chi = c0 + cw
        else:
            cw = min(corridor_width, across * 0.6)
            m = 0.5 * (c0 + c1)
            clo = m - cw / 2.0
            chi = m + cw / 2.0

        # One corridor Brep for the full span instead of one per bay.
        emit(AAB(s0, s1, clo, chi), "Corridor", -1, fi)

        for k in range(nn):
            end_lo = abs(e[k] - a0) < EPS
            end_hi = abs(e[k + 1] - a1) < EPS

            if layout_type == 1:
                for rec in place(TYPES[tindex % 3], e[k], e[k + 1], chi, c1):
                    emit_room(rec, apt, fi, end_lo, end_hi)

                apt += 1
                tindex += 1

            else:
                for rec in place(TYPES[tindex % 3], e[k], e[k + 1], clo, c0):
                    emit_room(rec, apt, fi, end_lo, end_hi)

                apt += 1

                for rec in place(TYPES[(tindex + 1) % 3], e[k], e[k + 1], chi, c1):
                    emit_room(rec, apt, fi, end_lo, end_hi)

                apt += 1
                tindex += 1


# ------------------------------------------------------------
# Console report
# ------------------------------------------------------------

print(
    "floors:%d spaces:%d apts:%d corridor:%d walls:%d doors:%d windows:%d" %
    (
        len(floors_sorted),
        len(Interior_Breps),
        len(set(i for i in Apartment_Id if i >= 0)),
        len(Corridor_Breps),
        len(Wall_Breps),
        len(Door_Breps),
        len(Window_Breps)
    )
)
# ---------- end residential_interior_layout_generator_py ----------
concatenate = Concatenate()
point = Point(residential_interior_layout_generator_py.Label_Points)
text = Text(residential_interior_layout_generator_py.Label_Text)
text_tag_3d = TextTag3D(Location=point, Text=text, Size=Slider(0.39, range=0..1), Justification=5)
macad_s_3_assignment_2 = Python3Script(
    Interior_Breps=residential_interior_layout_generator_py.Interior_Breps,
    Space_Types=residential_interior_layout_generator_py.Space_Types,
    Apartment_Id=residential_interior_layout_generator_py.Apartment_Id,
    Floor_Index=residential_interior_layout_generator_py.Floor_Index,
    Core_Brep=residential_interior_layout_generator_py.Corridor_Breps)  # -> out, Node_Points, Node_Ids, Node_Types, Node_Floors, Node_ApartmentIds, Node_Labels, Edge_Lines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; inputs Interior_Breps: list, Space_Types: list, Apartment_Id: list, Floor_Index: list, Core_Brep: list
# ---------- macad_s_3_assignment_2: Python ----------
# MaCAD S.3 - Assignment 2
# Building spaces to graph
# Rhino 8 Script Editor / Python 3
#
# Purpose:
#   Convert generated residential spaces into a graph.
#
# Graph logic:
#   Nodes = rooms, corridors, core
#   Edges = touching / connected spaces
#   Attributes = type, floor, apartment ID, centroid
#
# Inputs:
#   Interior_Breps              LIST
#   Space_Types                 LIST
#   Apartment_Id                LIST
#   Floor_Index                 LIST
#   Core_Brep                   LIST
#
# Optional inputs:
#   touch_tolerance             ITEM
#   make_core_vertical_edges    ITEM
#
# Outputs:
#   Node_Points
#   Node_Ids
#   Node_Types
#   Node_Floors
#   Node_ApartmentIds
#   Node_Labels
#   Edge_Lines
#   Edge_From
#   Edge_To
#   Edge_Type
#   Nodes_CSV
#   Edges_CSV
#   Report

import Rhino
import Rhino.Geometry as rg
import scriptcontext as sc
import System


# ------------------------------------------------------------
# Tolerance
# ------------------------------------------------------------

TOL = 0.001

try:
    if sc.doc and sc.doc.ModelAbsoluteTolerance > 0:
        TOL = sc.doc.ModelAbsoluteTolerance
except:
    pass


def dflt(v, d):
    return d if v is None else v


try:
    touch_tolerance = float(dflt(touch_tolerance, TOL * 10.0))
except:
    touch_tolerance = TOL * 10.0


try:
    make_core_vertical_edges = bool(dflt(make_core_vertical_edges, True))
except:
    make_core_vertical_edges = True


EPS = max(TOL * 5.0, touch_tolerance)


# ------------------------------------------------------------
# Input helpers
# ------------------------------------------------------------

def to_list(x):
    """
    Converts Grasshopper input to a normal Python list.

    Handles:
    - None
    - single item
    - list / tuple
    - Grasshopper iterable data
    """

    if x is None:
        return []

    if isinstance(x, list):
        return x

    if isinstance(x, tuple):
        return list(x)

    try:
        return list(x)
    except:
        return [x]


def coerce_brep(x):
    """
    Converts incoming Grasshopper / Rhino data to a Brep.

    Accepts:
    - Rhino.Geometry.Brep
    - Rhino object Guid
    - Grasshopper wrapper with .Value
    - Rhino object with .Geometry
    """

    if x is None:
        return None

    # Already a Brep.
    if isinstance(x, rg.Brep):
        if x.IsValid:
            return x
        return None

    # Grasshopper Goo wrapper.
    if hasattr(x, "Value"):
        try:
            return coerce_brep(x.Value)
        except:
            pass

    # Rhino document Guid.
    if isinstance(x, System.Guid):
        try:
            obj = sc.doc.Objects.FindId(x)

            if obj is None:
                return None

            geo = obj.Geometry

            if isinstance(geo, rg.Brep) and geo.IsValid:
                return geo

            return None
        except:
            return None

    # Rhino object with Geometry property.
    if hasattr(x, "Geometry"):
        try:
            geo = x.Geometry

            if isinstance(geo, rg.Brep) and geo.IsValid:
                return geo
        except:
            pass

    return None


def safe_item(values, i, default):
    try:
        if i < len(values):
            return values[i]
    except:
        pass

    return default


def as_int(value, default):
    try:
        return int(value)
    except:
        return default


def as_text(value, default):
    try:
        if value is None:
            return default
        return str(value)
    except:
        return default


# ------------------------------------------------------------
# Clean inputs
# ------------------------------------------------------------

spaces = []

for item in to_list(Interior_Breps):
    b = coerce_brep(item)

    if b is not None:
        spaces.append(b)


cores = []

for item in to_list(Core_Brep):
    b = coerce_brep(item)

    if b is not None:
        cores.append(b)


types_in = to_list(Space_Types)
apts_in = to_list(Apartment_Id)
floors_in = to_list(Floor_Index)


# ------------------------------------------------------------
# Geometry helpers
# ------------------------------------------------------------

def aabb(brep):
    return brep.GetBoundingBox(True)


def bbox_center(bb):
    return rg.Point3d(
        0.5 * (bb.Min.X + bb.Max.X),
        0.5 * (bb.Min.Y + bb.Max.Y),
        0.5 * (bb.Min.Z + bb.Max.Z)
    )


def overlap_len(a0, a1, b0, b1):
    return min(a1, b1) - max(a0, b0)


def boxes_touch(bb1, bb2, tol):
    """
    Returns True if two bounding boxes touch by face.
    This approximates adjacency between rectangular room Breps.
    """

    x_overlap = overlap_len(bb1.Min.X, bb1.Max.X, bb2.Min.X, bb2.Max.X)
    y_overlap = overlap_len(bb1.Min.Y, bb1.Max.Y, bb2.Min.Y, bb2.Max.Y)
    z_overlap = overlap_len(bb1.Min.Z, bb1.Max.Z, bb2.Min.Z, bb2.Max.Z)

    # Same floor / vertical overlap required.
    if z_overlap <= tol:
        return False

    # Face contact in X direction.
    touch_x = (
        abs(bb1.Max.X - bb2.Min.X) <= tol or
        abs(bb2.Max.X - bb1.Min.X) <= tol
    )

    if touch_x and y_overlap > tol:
        return True

    # Face contact in Y direction.
    touch_y = (
        abs(bb1.Max.Y - bb2.Min.Y) <= tol or
        abs(bb2.Max.Y - bb1.Min.Y) <= tol
    )

    if touch_y and x_overlap > tol:
        return True

    return False


def boxes_overlap_or_touch(bb1, bb2, tol):
    """
    Used for core connection.
    Allows touching or tiny overlap.
    """

    separated = (
        bb1.Max.X < bb2.Min.X - tol or
        bb1.Min.X > bb2.Max.X + tol or
        bb1.Max.Y < bb2.Min.Y - tol or
        bb1.Min.Y > bb2.Max.Y + tol or
        bb1.Max.Z < bb2.Min.Z - tol or
        bb1.Min.Z > bb2.Max.Z + tol
    )

    return not separated


# ------------------------------------------------------------
# Build space nodes
# ------------------------------------------------------------

nodes = []
bbs = []

for i, brep in enumerate(spaces):
    bb = aabb(brep)
    pt = bbox_center(bb)

    stype = as_text(safe_item(types_in, i, "Space"), "Space")
    aid = as_int(safe_item(apts_in, i, -999), -999)
    floor = as_int(safe_item(floors_in, i, 0), 0)

    node_id = "S_%04d" % i

    nodes.append({
        "id": node_id,
        "type": stype,
        "floor": floor,
        "apartment_id": aid,
        "point": pt,
        "brep": brep,
        "is_core": False
    })

    bbs.append(bb)


# ------------------------------------------------------------
# Infer floor z-ranges from space nodes
# ------------------------------------------------------------

floor_ranges = {}

for i, n in enumerate(nodes):
    f = n["floor"]
    bb = bbs[i]

    if f not in floor_ranges:
        floor_ranges[f] = [bb.Min.Z, bb.Max.Z]
    else:
        floor_ranges[f][0] = min(floor_ranges[f][0], bb.Min.Z)
        floor_ranges[f][1] = max(floor_ranges[f][1], bb.Max.Z)

known_floors = sorted(floor_ranges.keys())


# ------------------------------------------------------------
# Add one core node per floor
# ------------------------------------------------------------

core_node_indices = []

if cores and known_floors:
    core_union = cores[0].GetBoundingBox(True)

    for c in cores[1:]:
        core_union.Union(c.GetBoundingBox(True))

    for f in known_floors:
        z0, z1 = floor_ranges[f]

        core_pt = rg.Point3d(
            0.5 * (core_union.Min.X + core_union.Max.X),
            0.5 * (core_union.Min.Y + core_union.Max.Y),
            0.5 * (z0 + z1)
        )

        core_bb = rg.BoundingBox(
            rg.Point3d(core_union.Min.X, core_union.Min.Y, z0),
            rg.Point3d(core_union.Max.X, core_union.Max.Y, z1)
        )

        node_id = "CORE_F%02d" % f

        nodes.append({
            "id": node_id,
            "type": "Core",
            "floor": f,
            "apartment_id": -1,
            "point": core_pt,
            "brep": None,
            "is_core": True
        })

        bbs.append(core_bb)
        core_node_indices.append(len(nodes) - 1)


# ------------------------------------------------------------
# Build edges
# ------------------------------------------------------------

edges = []
edge_keys = set()


def add_edge(i, j, etype):
    if i == j:
        return

    a = min(i, j)
    b = max(i, j)

    # One undirected edge per pair and type.
    key = (a, b, etype)

    if key in edge_keys:
        return

    edge_keys.add(key)

    edges.append({
        "from": nodes[a]["id"],
        "to": nodes[b]["id"],
        "type": etype,
        "from_i": a,
        "to_i": b
    })


# ------------------------------------------------------------
# Space-space adjacency edges
# ------------------------------------------------------------

for i in range(len(nodes)):
    for j in range(i + 1, len(nodes)):

        ni = nodes[i]
        nj = nodes[j]

        # Core handled separately below.
        if ni["is_core"] or nj["is_core"]:
            continue

        # Only connect spaces on the same floor.
        if ni["floor"] != nj["floor"]:
            continue

        if boxes_touch(bbs[i], bbs[j], EPS):
            add_edge(i, j, "touching")


# ------------------------------------------------------------
# Core-space edges
# ------------------------------------------------------------

for ci in core_node_indices:
    core_floor = nodes[ci]["floor"]

    for si, n in enumerate(nodes):
        if n["is_core"]:
            continue

        if n["floor"] != core_floor:
            continue

        if boxes_overlap_or_touch(bbs[ci], bbs[si], EPS):
            add_edge(ci, si, "core_connection")


# ------------------------------------------------------------
# Vertical core edges
# ------------------------------------------------------------

if make_core_vertical_edges and len(core_node_indices) > 1:
    sorted_core = sorted(
        core_node_indices,
        key=lambda idx: nodes[idx]["floor"]
    )

    for a, b in zip(sorted_core[:-1], sorted_core[1:]):
        add_edge(a, b, "vertical_core")


# ------------------------------------------------------------
# Output geometry
# ------------------------------------------------------------

Node_Points = [n["point"] for n in nodes]
Node_Ids = [n["id"] for n in nodes]
Node_Types = [n["type"] for n in nodes]
Node_Floors = [n["floor"] for n in nodes]
Node_ApartmentIds = [n["apartment_id"] for n in nodes]

Node_Labels = [
    "%s | %s | F%s | Apt %s" %
    (
        n["id"],
        n["type"],
        n["floor"],
        n["apartment_id"]
    )
    for n in nodes
]

Edge_Lines = [
    rg.Line(
        nodes[e["from_i"]]["point"],
        nodes[e["to_i"]]["point"]
    )
    for e in edges
]

Edge_From = [e["from"] for e in edges]
Edge_To = [e["to"] for e in edges]
Edge_Type = [e["type"] for e in edges]


# ------------------------------------------------------------
# CSV outputs
# ------------------------------------------------------------

nodes_rows = []
nodes_rows.append("node_id,type,floor,apartment_id,x,y,z")

for n in nodes:
    p = n["point"]

    nodes_rows.append(
        "%s,%s,%s,%s,%.3f,%.3f,%.3f" %
        (
            n["id"],
            n["type"],
            n["floor"],
            n["apartment_id"],
            p.X,
            p.Y,
            p.Z
        )
    )

edges_rows = []
edges_rows.append("source,target,edge_type")

for e in edges:
    edges_rows.append(
        "%s,%s,%s" %
        (
            e["from"],
            e["to"],
            e["type"]
        )
    )

Nodes_CSV = "\n".join(nodes_rows)
Edges_CSV = "\n".join(edges_rows)


# ------------------------------------------------------------
# Report
# ------------------------------------------------------------

space_count = len([n for n in nodes if not n["is_core"]])
core_count = len([n for n in nodes if n["is_core"]])
corridor_count = len([n for n in nodes if n["type"] == "Corridor"])
room_count = space_count - corridor_count

touch_edges = len([e for e in edges if e["type"] == "touching"])
core_edges = len([e for e in edges if e["type"] == "core_connection"])
vertical_edges = len([e for e in edges if e["type"] == "vertical_core"])

Report = "\n".join([
    "GRAPH EXTRACTION REPORT",
    "-----------------------",
    "Nodes total: %d" % len(nodes),
    "Room / space nodes: %d" % room_count,
    "Corridor nodes: %d" % corridor_count,
    "Core nodes: %d" % core_count,
    "Edges total: %d" % len(edges),
    "Touching edges: %d" % touch_edges,
    "Core connection edges: %d" % core_edges,
    "Vertical core edges: %d" % vertical_edges,
    "",
    "Node attributes:",
    "- type",
    "- floor",
    "- apartment_id",
    "- x, y, z centroid",
    "",
    "Edge rule:",
    "- spaces connect when bounding boxes touch by face",
    "- core connects to spaces touching its floor slice",
    "- core floors connect vertically",
    "",
    "Warnings:",
    "- No spaces received" if len(spaces) == 0 else "- Spaces received: OK",
    "- No core received" if len(cores) == 0 else "- Core received: OK"
])

print(Report)
# ---------- end macad_s_3_assignment_2 ----------
panel = Panel(macad_s_3_assignment_2.Report)
graph_metrics_calculator_py = Python3Script(
    Node_Ids=macad_s_3_assignment_2.Node_Ids,
    Node_Points=macad_s_3_assignment_2.Node_Points,
    Node_Types=macad_s_3_assignment_2.Node_Types,
    Node_Floors=macad_s_3_assignment_2.Node_Floors,
    Node_ApartmentIds=macad_s_3_assignment_2.Node_ApartmentIds,
    Edge_From=macad_s_3_assignment_2.Edge_From,
    Edge_To=macad_s_3_assignment_2.Edge_To)  # -> out, Degree, Degree_Centrality, Betweenness, Clustering, Shortest_From_Start, Metric_Labels, Metric_CSV, Report; inputs Node_Ids: list, Node_Points: list, Node_Types: list, Node_Floors: list, Node_ApartmentIds: list, Edge_From: list, Edge_To: list, start_node_id: list
# ---------- graph_metrics_calculator_py: Python ----------
# MaCAD S.3 - Assignment 2
# Graph metrics component
# Rhino 8 Script Editor / Python 3
#
# Inputs:
#   Node_Ids              LIST
#   Node_Points           LIST
#   Node_Types            LIST
#   Node_Floors           LIST
#   Node_ApartmentIds     LIST
#   Edge_From             LIST
#   Edge_To               LIST
#   start_node_id         ITEM, optional
#
# Outputs:
#   Degree
#   Degree_Centrality
#   Betweenness
#   Clustering
#   Shortest_From_Start
#   Metric_Labels
#   Metric_CSV
#   Report

from collections import deque


# ------------------------------------------------------------
# Helpers
# ------------------------------------------------------------

def to_list(x):
    if x is None:
        return []

    if isinstance(x, list):
        return x

    if isinstance(x, tuple):
        return list(x)

    try:
        return list(x)
    except:
        return [x]


def safe_item(values, i, default):
    try:
        if i < len(values):
            return values[i]
    except:
        pass

    return default


def as_text(x, default=""):
    try:
        if x is None:
            return default
        return str(x)
    except:
        return default


def as_int(x, default=0):
    try:
        return int(x)
    except:
        return default


# ------------------------------------------------------------
# Clean inputs
# ------------------------------------------------------------

node_ids = [as_text(x) for x in to_list(Node_Ids)]
node_types = [as_text(x, "Space") for x in to_list(Node_Types)]
node_floors = [as_int(x, 0) for x in to_list(Node_Floors)]
node_apts = [as_int(x, -999) for x in to_list(Node_ApartmentIds)]

edge_from = [as_text(x) for x in to_list(Edge_From)]
edge_to = [as_text(x) for x in to_list(Edge_To)]

try:
    start_node_id = as_text(start_node_id, "")
except:
    start_node_id = ""


n = len(node_ids)

id_to_i = {}
for i, node_id in enumerate(node_ids):
    id_to_i[node_id] = i


# ------------------------------------------------------------
# Build undirected adjacency list
# ------------------------------------------------------------

adj = {}

for i in range(n):
    adj[i] = set()


for a_id, b_id in zip(edge_from, edge_to):
    if a_id not in id_to_i:
        continue

    if b_id not in id_to_i:
        continue

    a = id_to_i[a_id]
    b = id_to_i[b_id]

    if a == b:
        continue

    adj[a].add(b)
    adj[b].add(a)


# ------------------------------------------------------------
# Degree centrality
# ------------------------------------------------------------

Degree = [len(adj[i]) for i in range(n)]

if n > 1:
    Degree_Centrality = [float(d) / float(n - 1) for d in Degree]
else:
    Degree_Centrality = [0.0 for d in Degree]


# ------------------------------------------------------------
# Betweenness centrality
# Brandes algorithm, unweighted undirected graph
# ------------------------------------------------------------

def betweenness_centrality(adj, n):
    cb = [0.0 for _ in range(n)]

    for s in range(n):
        stack = []
        pred = [[] for _ in range(n)]

        sigma = [0.0 for _ in range(n)]
        sigma[s] = 1.0

        dist = [-1 for _ in range(n)]
        dist[s] = 0

        q = deque()
        q.append(s)

        while q:
            v = q.popleft()
            stack.append(v)

            for w in adj[v]:
                if dist[w] < 0:
                    q.append(w)
                    dist[w] = dist[v] + 1

                if dist[w] == dist[v] + 1:
                    sigma[w] += sigma[v]
                    pred[w].append(v)

        delta = [0.0 for _ in range(n)]

        while stack:
            w = stack.pop()

            for v in pred[w]:
                if sigma[w] != 0:
                    delta[v] += (sigma[v] / sigma[w]) * (1.0 + delta[w])

            if w != s:
                cb[w] += delta[w]

    # Undirected graph correction.
    cb = [x / 2.0 for x in cb]

    # Normalization.
    if n > 2:
        scale = 2.0 / float((n - 1) * (n - 2))
        cb = [x * scale for x in cb]

    return cb


Betweenness = betweenness_centrality(adj, n)


# ------------------------------------------------------------
# Clustering coefficient
# ------------------------------------------------------------

def clustering_for_node(i):
    neighbors = list(adj[i])
    k = len(neighbors)

    if k < 2:
        return 0.0

    links = 0

    for a_index in range(k):
        for b_index in range(a_index + 1, k):
            a = neighbors[a_index]
            b = neighbors[b_index]

            if b in adj[a]:
                links += 1

    possible = k * (k - 1) / 2.0

    if possible == 0:
        return 0.0

    return float(links) / possible


Clustering = [clustering_for_node(i) for i in range(n)]


# ------------------------------------------------------------
# Shortest path distance from start node
# ------------------------------------------------------------

def find_default_start():
    # Prefer first core node.
    for i, t in enumerate(node_types):
        if t.lower() == "core":
            return i

    # Otherwise prefer first corridor.
    for i, t in enumerate(node_types):
        if t.lower() == "corridor":
            return i

    # Otherwise first node.
    if n > 0:
        return 0

    return None


if start_node_id and start_node_id in id_to_i:
    start_i = id_to_i[start_node_id]
else:
    start_i = find_default_start()


Shortest_From_Start = [-1 for _ in range(n)]

if start_i is not None:
    q = deque()
    q.append(start_i)
    Shortest_From_Start[start_i] = 0

    while q:
        v = q.popleft()

        for w in adj[v]:
            if Shortest_From_Start[w] == -1:
                Shortest_From_Start[w] = Shortest_From_Start[v] + 1
                q.append(w)


# ------------------------------------------------------------
# Labels for visualization
# ------------------------------------------------------------

Metric_Labels = []

for i in range(n):
    label = (
        "%s | %s | F%s | Apt %s\n"
        "deg=%s | bet=%.3f | clust=%.3f | d_core=%s"
        %
        (
            node_ids[i],
            safe_item(node_types, i, "Space"),
            safe_item(node_floors, i, 0),
            safe_item(node_apts, i, -999),
            Degree[i],
            Betweenness[i],
            Clustering[i],
            Shortest_From_Start[i]
        )
    )

    Metric_Labels.append(label)


# ------------------------------------------------------------
# CSV output
# ------------------------------------------------------------

rows = []
rows.append(
    "node_id,type,floor,apartment_id,degree,degree_centrality,betweenness,clustering,shortest_from_start"
)

for i in range(n):
    rows.append(
        "%s,%s,%s,%s,%s,%.6f,%.6f,%.6f,%s"
        %
        (
            node_ids[i],
            safe_item(node_types, i, "Space"),
            safe_item(node_floors, i, 0),
            safe_item(node_apts, i, -999),
            Degree[i],
            Degree_Centrality[i],
            Betweenness[i],
            Clustering[i],
            Shortest_From_Start[i]
        )
    )

Metric_CSV = "\n".join(rows)


# ------------------------------------------------------------
# Summary report
# ------------------------------------------------------------

def max_node(values):
    if not values:
        return ("None", 0)

    max_i = 0
    max_v = values[0]

    for i, v in enumerate(values):
        if v > max_v:
            max_i = i
            max_v = v

    return (node_ids[max_i], max_v)


max_degree_node, max_degree_value = max_node(Degree)
max_bet_node, max_bet_value = max_node(Betweenness)
max_cluster_node, max_cluster_value = max_node(Clustering)

reachable = len([d for d in Shortest_From_Start if d >= 0])
unreachable = n - reachable

start_label = "None"
if start_i is not None:
    start_label = node_ids[start_i]

Report = "\n".join([
    "GRAPH METRICS REPORT",
    "--------------------",
    "Nodes: %d" % n,
    "Edges: %d" % len(edge_from),
    "Start node: %s" % start_label,
    "",
    "Highest degree:",
    "- %s = %s" % (max_degree_node, max_degree_value),
    "",
    "Highest betweenness:",
    "- %s = %.6f" % (max_bet_node, max_bet_value),
    "",
    "Highest clustering:",
    "- %s = %.6f" % (max_cluster_node, max_cluster_value),
    "",
    "Reachability:",
    "- Reachable nodes: %d" % reachable,
    "- Unreachable nodes: %d" % unreachable,
    "",
    "Spatial reading:",
    "- High degree = connector space",
    "- High betweenness = bridge or bottleneck",
    "- High clustering = local apartment grouping",
    "- Short path from core = better accessibility"
])

print(Report)
# ---------- end graph_metrics_calculator_py ----------
geometry = Geometry(bgr_residential_massing_generator_py.Ground_Breps)
geometry_2 = Geometry(bgr_residential_massing_generator_py.Column_Breps)
geometry_3 = Geometry(bgr_residential_massing_generator_py.Core_Brep)
geometry_4 = Geometry(residential_interior_layout_generator_py.Interior_Breps)
panel_2 = Panel(graph_metrics_calculator_py.Report)
custom_preview = CustomPreview(Geometry=geometry, Material=ColourSwatch(SwatchColor=RGB(69, 69, 69)))
custom_preview_2 = CustomPreview(Geometry=geometry_2, Material=ColourSwatch(SwatchColor=RGB(99, 99, 99)))
custom_preview_3 = CustomPreview(Geometry=geometry_3, Material=ColourSwatch(SwatchColor=RGB(112, 112, 112)))
custom_preview_4 = CustomPreview(Geometry=geometry_4, Material=ColourSwatch(SwatchColor=RGBA(207, 207, 207, 176)))
graph_metrics_csv_exporter_py = Python3Script(
    Nodes_CSV=macad_s_3_assignment_2.Nodes_CSV,
    Edges_CSV=macad_s_3_assignment_2.Edges_CSV,
    Metric_CSV=graph_metrics_calculator_py.Metric_CSV,
    folder_path="D:\GitHub\assignment1-s3-graph-generation\data\csv",
    save=Toggle(False))  # -> out, Saved_Paths, Report; inputs save: Boolean
# ---------- graph_metrics_csv_exporter_py: Python ----------
# MaCAD S.3 - Assignment 2
# CSV export component
# Rhino 8 Script Editor / Python 3
#
# Inputs:
#   Nodes_CSV      ITEM / Text
#   Edges_CSV      ITEM / Text
#   Metric_CSV     ITEM / Text
#   folder_path    ITEM / Text
#   save           ITEM / Boolean
#
# Outputs:
#   Saved_Paths
#   Report

import os
import datetime


# ------------------------------------------------------------
# Safe input reading
# ------------------------------------------------------------

def get_input(name, default):
    try:
        return globals()[name]
    except:
        return default


def dflt(v, d):
    return d if v is None else v


raw_save = get_input("save", False)

try:
    save_value = bool(dflt(raw_save, False))
except:
    save_value = False


try:
    folder_path_value = str(dflt(get_input("folder_path", ""), ""))
except:
    folder_path_value = ""


try:
    nodes_csv = str(dflt(get_input("Nodes_CSV", ""), ""))
except:
    nodes_csv = ""


try:
    edges_csv = str(dflt(get_input("Edges_CSV", ""), ""))
except:
    edges_csv = ""


try:
    metric_csv = str(dflt(get_input("Metric_CSV", ""), ""))
except:
    metric_csv = ""


# ------------------------------------------------------------
# Helpers
# ------------------------------------------------------------

def clean_folder(path):
    path = path.strip().strip('"').strip("'")

    if path == "":
        return None

    return path


def write_text(path, text):
    with open(path, "w", encoding="utf-8") as f:
        f.write(text)


# ------------------------------------------------------------
# Save files
# ------------------------------------------------------------

Saved_Paths = []
folder = clean_folder(folder_path_value)

if not save_value:
    Report = "\n".join([
        "CSV EXPORT READY",
        "----------------",
        "Set save = True to write files.",
        "",
        "Folder path:",
        str(folder_path_value),
        "",
        "Expected files:",
        "- nodes_YYYYMMDD_HHMMSS.csv",
        "- edges_YYYYMMDD_HHMMSS.csv",
        "- metrics_YYYYMMDD_HHMMSS.csv"
    ])

else:
    if folder is None:
        Report = "ERROR: folder_path is empty."

    elif not os.path.isdir(folder):
        Report = "ERROR: folder_path does not exist:\n%s" % folder

    else:
        timestamp = datetime.datetime.now().strftime("%Y%m%d_%H%M%S")

        nodes_path = os.path.join(folder, "nodes_%s.csv" % timestamp)
        edges_path = os.path.join(folder, "edges_%s.csv" % timestamp)
        metrics_path = os.path.join(folder, "metrics_%s.csv" % timestamp)

        try:
            write_text(nodes_path, nodes_csv)
            write_text(edges_path, edges_csv)
            write_text(metrics_path, metric_csv)

            Saved_Paths = [
                nodes_path,
                edges_path,
                metrics_path
            ]

            Report = "\n".join([
                "CSV EXPORT COMPLETE",
                "-------------------",
                "Saved files:",
                nodes_path,
                edges_path,
                metrics_path
            ])

        except Exception as e:
            Report = "ERROR while saving files:\n%s" % str(e)


print(Report)
# ---------- end graph_metrics_csv_exporter_py ----------
panel_3 = Panel(graph_metrics_csv_exporter_py.Report)
